# Grasshopper definition assignment-01.ghx (Grasshopper 1.0.8)

# ---- group: Arched Wall
pt = Point(Point(16.84452662, 0.8625667333, 0))
arch_boolean = Python3Script(
    pt=pt,
    opening_span=Slider(15.324, range=0.5..50.5),
    thickness=Slider(7.335, range=1..50),
    depth=Slider(2.308, range=0.5..15),
    leg_height=Slider(12.05, range=0.5..50),
    lintel_height=Slider(3.52, range=2..40))  # -> out, a, b; inputs pt: Point3d; disabled
# ---------- arch_boolean: Python ----------
from cdf.geometry_basics import create_arch_boolean_parts

a, b = create_arch_boolean_parts(
    base_point=pt,
    opening_span=opening_span,
    thickness=thickness,
    depth=depth,
    leg_height=leg_height,
    lintel_height=lintel_height,
)
# ---------- end arch_boolean ----------
sdiff = SolidDifference(BrepsA=arch_boolean.a, BrepsB=arch_boolean.b)
pt_2 = Point(Point(15.63661299, 16.94802794, 0))
rotate = Rotate(Geometry=sdiff, Angle=Slider(1.576, range=0..10), Plane=pt_2)  # -> Geometry, Transform
preview = CustomPreview(Geometry=rotate.Geometry, Material=ColourSwatch(SwatchColor=RGBA(0, 0, 201, 82)))

# ---- group: Helix
pt_3 = Point(Point(-3.705568812, 5.488688274, 0.005479509508))
helix = Python3Script(
    Pt=pt_3,
    turns=Slider(4, range=1..10),
    radius=Slider(3.243, range=0.1..15),
    height=Slider(23.282, range=0.1..50),
    min_width=Slider(0.1, range=0..100),
    max_width=Slider(1.774, range=0.1..100),
    points_per_turn=Slider(28, range=1..48))  # -> out, a, b; inputs Pt: Point3d; disabled
# ---------- helix: Python ----------
from cdf.geometry_basics import create_double_helix_surface

a, b = create_double_helix_surface(
    base_point=Pt,
    radius=radius,
    height=height,
    turns=turns,
    min_width=min_width,
    max_width=max_width,
    points_per_turn=points_per_turn,
)
# ---------- end helix ----------
preview_2 = CustomPreview(Geometry=helix.a, Material=ColourSwatch(SwatchColor=RGBA(59, 64, 201, 82)))

# ----
pt_4 = Point(Point(3.975694722, -1.901463079, 0))

# ---- group: Staircase
pt_5 = Point(Point(-18.31369038, -1.98760039, 0.3663076708))
staircase = Python3Script(
    base_pt=pt_5,
    step_count=Slider(10, range=1..10),
    width=Slider(8.128, range=0.1..15),
    step_depth=Slider(1.231, range=0.1..10),
    step_height=Slider(0.733, range=0.1..10))  # -> out, a; inputs base_pt: Point3d
# ---------- staircase: Python ----------
from cdf.geometry_basics import create_staircase

a = create_staircase(
    base_point=base_pt,
    step_count=step_count,
    width=width,
    step_depth=step_depth,
    step_height=step_height,
)
# ---------- end staircase ----------
preview_3 = CustomPreview(Geometry=staircase.a, Material=ColourSwatch(SwatchColor=RGBA(59, 64, 201, 82)))

# ---- group: Solid Staircase
pt_6 = Point(Point(-18.31654861, -1.361190571, -0.009968951487))
solid_staircase = Python3Script(
    base_pt=pt_6,
    step_count=Slider(1, range=1..10),
    width=Slider(8.135, range=0.1..15),
    step_depth=Slider(1.231, range=0.1..10),
    step_height=Slider(0.733, range=0.1..10))  # -> out, a; inputs base_pt: Point3d; disabled
# ---------- solid_staircase: Python ----------
from cdf.geometry_basics import create_solid_staircase

a = create_solid_staircase(
    base_point=base_pt,
    step_count=step_count,
    width=width,
    step_depth=step_depth,
    step_height=step_height,
)
# ---------- end solid_staircase ----------
swatch = ColourSwatch(SwatchColor=RGBA(121, 107, 201, 82))
preview_4 = CustomPreview(
    Geometry=solid_staircase.a,
    Material={diffuse=RGB(221, 160, 221), emission=RGB(66, 48, 66), shine=0.5, specular=RGB(255, 255, 255), transparency=0})

# ---- group: Box
pt_7 = Point(Point(-18.31325697, 12.82556331, 6.973574883))
box = Python3Script(
    center_point=pt_7,
    width=Slider(8.135, range=1..50),
    depth=Slider(6.211, range=0.1..10),
    height=Slider(0.719, range=0.1..10))  # -> out, my_box; inputs center_point: Point3d, width: Double, depth: Double, height: Double
# ---------- box: Python ----------
# import function
from cdf import create_box

# call function
my_box = create_box(center_point=center_point, width=width, depth=depth, height=height)
# ---------- end box ----------

pt_8 = Point(Point(1.16092101, 4.97926189, 0))
box_2 = Python3Script(center_point=pt_8, width=Slider(1.6, range=1..10), depth=Slider(1, range=1..10), height=Slider(5.002, range=1..10))  # -> out, my_box; inputs center_point: Point3d, width: Double, depth: Double, height: Double; disabled; same code as box

# ---- group: Cylinder
pt_9 = Point(Point(35.63933957, 1.995815575, 14.51592506))
cylinder = Python3Script(center_point=pt_9, r=Slider(1.076, range=0.5..10), h=Slider(29.103, range=1..50))  # -> out, my_cylinder; inputs center_point: Point3d, r: Double, h: Double; disabled
# ---------- cylinder: Python ----------
# import function
from cdf import create_cylinder

# call function
my_cylinder = create_cylinder(center_point=center_point, radius=r, height=h)
# ---------- end cylinder ----------

# ---- group: Box
preview_5 = CustomPreview(Geometry=box.my_box, Material=ColourSwatch(SwatchColor=RGBA(210, 184, 201, 82)))

preview_6 = CustomPreview(Geometry=box_2.my_box, Material=ColourSwatch(SwatchColor=RGBA(210, 184, 201, 82)))

# ----
pt_10 = Point(Point(30.5614836, 18.23431052, 0))

# ---- group: Cylinder
preview_7 = CustomPreview(Geometry=cylinder.my_cylinder, Material=ColourSwatch(SwatchColor=RGBA(210, 184, 201, 82)))

# ----
merge = Merge(Data1=solid_staircase.a, Data2=staircase.a, Data3=box.my_box)
xy = XYPlane(Origin=Point(0, 0, 0))
rotate_2 = Rotate(Geometry=merge, Angle=Slider(4.723, range=0..10), Plane=xy)  # -> Geometry, Transform
flip = Flip()  # -> Surface, Result

# ---- group: SPHERE
number_slider = Slider(1.211, range=0..5)
pt_11 = Point(Point(-11.41737154, 6.845795086, 5.432814437))

# ---- group: Example: Build a Parametric Cone
r = Slider(4, range=1..10)
pt_12 = Point(Point(-12.33373891, 1.98469982, 23.24122905))
cone = Python3Script(pt=pt_12, h=Slider(2, range=1..10), r=r)  # -> out, my_cone; inputs pt: Point3d
# ---------- cone: Python ----------
# import function
from cdf import create_cone

# call function
my_cone = create_cone(base_point=pt, height=h, radius=r)
# ---------- end cone ----------

# ---- group: Auto-reloads cdf module on VScode changes
# Setting path for Src AutoReloader: 1. Right click on Path
# 2. Choose "Select a directory"
# 3. Locate the ..\cdf1_teaching\src folder in your computer
# NOTES:
# 
# - Use Python 3 Script blocks for your functions.
# - Import your functions and classes as: from cdf import my_function, My_class
# - Don't forget to add and name your INPUT and OUTPUT parameters that match your functions correctly. If you zoom in to the Python component you will see the + sign to add and - to remove them.
# - You need to attach the accurate components to your INPUT parameters: sliders for integers or floats, toggles or buttons for booleans, text for strings, Rhino geometries etc. etc.
# - If an INPUT is  a list, you need to right-click the parameter to set it as LIST access. Sometimes you need to also set the type of the INPUT by clicking TYPE HINT and selecting the correct input type.
# - If you want to hide an object, right-click component and uncheck Preview. To visualize again, check Preview.
# - If you get errors, READ THEM! They often tell what's wrong in a simple language. If not, copy-paste to CoPilot and don't be afraid to play around!
# 
# For more Grasshopper Help, go to:
# https://developer.rhino3d.com/guides/scripting/scripting-component/#script-inputs-and-outputs
path = FilePath("C:\Users\samar\OneDrive\Documents\GitHub\cdf1_teaching\src\")
autoreloader = Python3Script(src_path=path)  # -> out; inputs src_path: String
# ---------- autoreloader: Python ----------
#! python3
import sys, os, time
import scriptcontext as sc
import Rhino, System
from System.IO import FileSystemWatcher, NotifyFilters

VERSION = 1  
pkg = "cdf"

if not src_path:
    raise Exception("Connect a folder to src_path.")
path = os.path.normpath(src_path)
watch_dir = os.path.join(path, pkg)
if not os.path.isdir(watch_dir):
    raise Exception("No '{}' folder found in:\n{}".format(pkg, path))

def unload():
    for name in list(sys.modules):
        if name == pkg or name.startswith(pkg + "."):
            del sys.modules[name]

# Put this folder first in Python's search list
if path in sys.path:
    sys.path.remove(path)
sys.path.insert(0, path)

key = "cdf_watcher_" + str(ghenv.Component.InstanceGuid)
time_key = key + "_time"
version_key = key + "_version"

def stamp():
    sc.sticky[time_key] = time.strftime("%Y-%m-%d %H:%M:%S")

# Replace the old watcher if the folder changed or the script was updated
old = sc.sticky.get(key)
if old is not None and (os.path.normpath(old.Path) != watch_dir
                        or sc.sticky.get(version_key) != VERSION):
    old.Dispose()
    del sc.sticky[key]
    unload()

if key not in sc.sticky:
    comp = ghenv.Component
    last = [0.0]

    def reload_and_rerun():
        unload()
        stamp()
        doc = comp.OnPingDocument()
        if doc is None:            # reloader was deleted or the file closed
            return
        for obj in doc.Objects:
            if "Python" in obj.GetType().Name:
                obj.ExpireSolution(False)   # mark as out of date
        doc.NewSolution(False)              # recompute once

    def on_change(sender, e):
        if not e.FullPath.endswith(".py") or "__pycache__" in e.FullPath:
            return
        if time.time() - last[0] < 0.5:     # ignore the second event of a double save
            return
        last[0] = time.time()
        Rhino.RhinoApp.InvokeOnUiThread(System.Action(reload_and_rerun))

    w = FileSystemWatcher(watch_dir, "*.py")
    w.IncludeSubdirectories = True
    w.NotifyFilter = NotifyFilters.LastWrite
    w.Changed += on_change
    w.EnableRaisingEvents = True
    sc.sticky[key] = w
    sc.sticky[version_key] = VERSION
    stamp()                                  # time the watcher started

msg = "Last reloaded: {}\nWatching: {}".format(sc.sticky.get(time_key, "unknown"), watch_dir)
print(msg)
out = msg
# ---------- end autoreloader ----------
panel = Panel(autoreloader)

# ---- group: SPHERE / TODO: Build a Parametric Sphere
sphere = Python3Script(center=pt_11, r=number_slider)  # -> out, my_sphere; inputs center: Point3d
# ---------- sphere: Python ----------
# import function
from cdf import create_sphere

# call function
my_sphere = create_sphere(center,r)
# ---------- end sphere ----------

# ----
merge_2 = Merge(Data1=sphere.my_sphere, Data2=cylinder.my_cylinder)

# ---- group: TODO: Make Transformations
transformation = Python3Script(my_sphere=sphere.my_sphere, distance=Slider(1.8, range=1..10), count=Slider(5, range=1..10))  # -> out, my_spheres; inputs my_sphere: Brep
# ---------- transformation: Python ----------
from cdf import copy_brep_along_z

my_spheres = copy_brep_along_z(my_sphere, distance, count)
# ---------- end transformation ----------

# ---- group: TODO: Make a Boolean Difference
boolean = Python3Script(my_cone=cone.my_cone, my_sphere=sphere.my_sphere, x=merge_2, my_box=box_2.my_box, my_cylinder=cylinder.my_cylinder)  # -> out, result_geometry; inputs my_cone: Brep, my_sphere: Brep, x: list of Brep, my_cylinder: list
# ---------- boolean: Python ----------
from cdf import boolean_difference

result_geometry = boolean_difference(my_cone, x)
# ---------- end boolean ----------

boolean_2 = Python3Script(my_cone=cone.my_cone)  # -> out, result_geometry; inputs my_cone: Brep, my_sphere: Brep
# ---------- boolean_2: Python ----------
from cdf import boolean_difference

result_geometry = boolean_difference(my_cone, my_sphere)
# ---------- end boolean_2 ----------

# ---- group: Visualize
preview_8 = CustomPreview(Geometry=cone.my_cone, Material=ColourSwatch(SwatchColor=RGB(50, 217, 78)))

preview_9 = CustomPreview(Geometry=boolean.result_geometry, Material=ColourSwatch(SwatchColor=RGB(255, 86, 255)))

# ---- group: SPHERE / Visualize
preview_10 = CustomPreview(Geometry=sphere.my_sphere, Material=ColourSwatch(SwatchColor=RGB(255, 86, 88)))

# ---- group: Visualize
preview_11 = CustomPreview(Geometry=transformation.my_spheres, Material=ColourSwatch(SwatchColor=RGB(255, 255, 96)))

preview_12 = CustomPreview(Geometry=boolean_2.result_geometry, Material=ColourSwatch(SwatchColor=RGB(255, 255, 96)))

# ----
py3 = Python3Script()  # -> out, a; unedited script template
panel_2 = Panel(py3.out)

# ---- group: Bowed Arch
pt_13 = Point(Point(16.88065451, 0.8628235227, 0.007427581272))
arch = Python3Script(
    pt=pt_13,
    s=Slider(12.917, range=2.5..50),
    t=Slider(1.359, range=1..10),
    d=Slider(2.313, range=1..10),
    lh=Slider(10.597, range=1..50))  # -> out, my_arch; inputs pt: Point3d, s: Double, t: Double; disabled
# ---------- arch: Python ----------
# import function
from cdf import create_arch

# call function
my_arch = create_arch(base_point=pt, span=s, thickness=t, depth=d, leg_height=lh)
# ---------- end arch ----------

# ----
rotate_3 = Rotate(Geometry=arch.my_arch, Angle=Slider(1.578, range=0..10), Plane=pt_4)  # -> Geometry, Transform; disabled

# ---- group: Bowed Arch (continued)
preview_13 = CustomPreview(Geometry=rotate_3.Geometry, Material=ColourSwatch(SwatchColor=RGBA(210, 184, 201, 82)))

# ---- group: Arch
pt_14 = Point(Point(30.55990374, 17.09776682, 0))
arch_module = Python3Script(
    pt=pt_14,
    s=Slider(10.324, range=2.5..50),
    t=Slider(0.302, range=0.1..10),
    d=Slider(2.309, range=1..10),
    lh=Slider(8.938, range=1..50),
    lintel_height=Slider(3.915, range=1..10))  # -> out, a; inputs pt: Point3d, s: Double, t: Double; disabled
# ---------- arch_module: Python ----------
# import function
from cdf import create_arch_module



# call function
#my_arch_module = create_arch_module(base_point=pt, span=s, thickness=t, depth=d, leg_height=lh, lintel_height=lintel)

a = create_arch_module(
base_point=pt,
span=s,
    thickness=t,
    depth=d,
    leg_height=lh,
    lintel_height=lintel_height
)
# ---------- end arch_module ----------

# ----
rotate_4 = Rotate(Geometry=arch_module.a, Angle=Slider(4.712, range=0..10), Plane=pt_10)  # -> Geometry, Transform

# ---- group: Arch (continued)
preview_14 = CustomPreview(Geometry=rotate_4.Geometry, Material=ColourSwatch(SwatchColor=RGBA(210, 184, 201, 82)))

# ----
boolean_3 = Python3Script(my_box=box_2.my_box, arch_module=arch_module.a)  # -> out, result_geometry; inputs my_box: Brep, arch_module: Brep, x: list of Brep
# ---------- boolean_3: Python ----------
from cdf import boolean_difference

result_geometry = boolean_difference(my_box, x)
# ---------- end boolean_3 ----------
